# Grasshopper definition Convert Rhino point to Grashopper geom.gh (Grasshopper 1.0.4)

minimal_interior_floor_height_m = Slider(1.8, range=0..5)
floor_slab_thickness_m = Slider(0.5, range=0.1..1.5)
box_scale_m = Slider(10, range=0..20)
box_width = Slider(1, range=0..2)
box_depth = Slider(1, range=0..2)
box_height = Slider(1, range=0..2)
load_points_box_bottom_corner = Point([<point referenced from the Rhino model> x1327])
coords = ImportCoordinates(
    File="/Users/emielgovaert/Dropbox/School/Thesis/Visualisatie/Rhino import + scripting/export.csv",
    Separator=",",
    Comment="0",
    XIndex=0,
    YIndex=1,
    ZIndex=2)
panel = Panel(coords)
floor_slab = Division(A=floor_slab_thickness_m, B=box_scale_m)
number_of_floors = Evaluate(F="(h-f)/(m+f)", h=box_scale_m, f=floor_slab_thickness_m, m=minimal_interior_floor_height_m)
pdecon = Deconstruct(Point=load_points_box_bottom_corner)  # -> XComponent, YComponent, ZComponent
round = Round(Number=number_of_floors)  # -> Nearest, Floor, Ceiling
total_floors_height = Evaluate(F="(h-f)/n", h=box_scale_m, f=floor_slab_thickness_m, n=round.Floor)
total_floor_height = Panel(total_floors_height)
posible_num_of_floors = Panel(number_of_floors)
max_num_of_floors = Panel(round.Floor)
division = Division(A=total_floor_height, B=box_scale_m)
series = Series(Start=pdecon.ZComponent, Step=1, Count=10)  # -> simplify(Series)
int = Integer(pdecon.YComponent)
box_x_top = Addition(A=pdecon.XComponent, B=box_width)
box_y_top = Addition(A=pdecon.YComponent, B=box_depth)
box_z_top = Addition(A=pdecon.ZComponent, B=box_height)
floor_slab_height = Addition(A=pdecon.ZComponent, B=floor_slab)
floor_slab_height_2 = Addition(A=pdecon.ZComponent, B=division)
box = CenterBox(Base=PlaneXY(0, 0, 0), X=1, Y=1, Z=1)
subtraction = Subtraction(A=box_z_top, B=floor_slab)
addition = Addition(A=floor_slab_height_2, B=floor_slab)
box_top_corner = ConstructPoint(XCoordinate=box_x_top, YCoordinate=box_y_top, ZCoordinate=box_z_top)
roof_bottom_corner = ConstructPoint(XCoordinate=pdecon.XComponent, YCoordinate=pdecon.YComponent, ZCoordinate=subtraction)
floor_top_corner = ConstructPoint(XCoordinate=box_x_top, YCoordinate=box_y_top, ZCoordinate=floor_slab_height)
first_floor_bottom_corner = ConstructPoint(XCoordinate=pdecon.XComponent, YCoordinate=pdecon.YComponent, ZCoordinate=floor_slab_height_2)
first_floor_top_corner = ConstructPoint(XCoordinate=box_x_top, YCoordinate=box_y_top, ZCoordinate=addition)
floor_slab_2 = Box2Pt(PointA=first_floor_bottom_corner, PointB=first_floor_top_corner, Plane=PlaneXY(0, 0, 0))
box_2 = Box2Pt(PointA=load_points_box_bottom_corner, PointB=box_top_corner, Plane=PlaneXY(0, 0, 0))  # disabled
roof_slab = Box2Pt(PointA=roof_bottom_corner, PointB=box_top_corner, Plane=PlaneXY(0, 0, 0))
floor_slab_3 = Box2Pt(PointA=load_points_box_bottom_corner, PointB=floor_top_corner, Plane=PlaneXY(0, 0, 0))
